# Grasshopper definition hysteresis-remote.ghx (Grasshopper 0.9.76)
# plug-ins: Python Interpreter, Flux

flux = FluxProject(project="a9jAyvE70YL3qR5WZ")  # -> Keys, Meta
flow_control = FlowControl({"Once", "Constantly"}, selected="Constantly")
from_flux = FromFlux(
    Keys=flux.Keys,
    Mode=flow_control,
    keyId="40125174d928b38689aec28fc8e6e8ed",
    mode="Constantly",
    Branch0_Path="{0}",
    Branch0_Item0_null_string=False,
    Branch0_Item0_string="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",
    Branch0_Item0_TypeName="Grasshopper.Kernel.Types.GH_String")  # -> Value, Meta
to_flux = ToFlux(Keys=flux.Keys, Mode=flow_control, keyId="40cb7ce2f54c0b988a90e04600d8d638", mode="Constantly")  # disabled
placexmlsnippet = CSharpScript(x=from_flux.Value)  # -> out, A; inputs x: String
# ---------- placexmlsnippet: C# ----------
    string xmlSnippet = x;
    ClearCanvas();
    System.Windows.Forms.Clipboard.SetText(xmlSnippet);
    Paste();
# ---------- placexmlsnippet: C# additional code ----------
  void ClearCanvas(){
    GH_DocumentIO docIO = new GH_DocumentIO(GrasshopperDocument);
    List<IGH_DocumentObject> objectsToKeep = new List<IGH_DocumentObject>();
    List<IGH_DocumentObject> objectsToClear = new List<IGH_DocumentObject>();
    Grasshopper.Kernel.Special.GH_Group grp = new Grasshopper.Kernel.Special.GH_Group();

    foreach(IGH_DocumentObject obj in GrasshopperDocument.Objects){ //for all objs in GH doc

      if(obj is Grasshopper.Kernel.Special.GH_Group){ //if it's a group
        grp = obj as Grasshopper.Kernel.Special.GH_Group;
        //if the group contains this script, add those objects to the objectsToKeep list
        if(grp.Objects().Exists(x => x.InstanceGuid == this.Component.InstanceGuid)){
          objectsToKeep.Add(obj);
          foreach(IGH_DocumentObject grpObj in grp.Objects()){ // for all the objects in the group
            objectsToKeep.Add(grpObj);
          }
        }
      }
      //start objectsToClear list with all objects
      objectsToClear = GrasshopperDocument.Objects.ToList();
    }
    //remove objectsToKeep from objectsToClear
    foreach(IGH_DocumentObject obj in objectsToKeep){
      objectsToClear.Remove(obj);
    }
    //delete remaining items
    foreach(IGH_DocumentObject obj in objectsToClear){
      GrasshopperDocument.Objects.Remove(obj);
    }

  } 
  
  void Paste(){
    GH_DocumentIO documentIO = new GH_DocumentIO();
    documentIO.Paste(GH_ClipboardType.System);
    var thispivot = this.Component.Attributes.Pivot;

    int smallestX = Int32.MaxValue;
    int smallestY = Int32.MaxValue;
    foreach(IGH_DocumentObject obj in documentIO.Document.Objects){
      var pivot = obj.Attributes.Pivot;
      if(pivot.X < smallestX) smallestX = (int) pivot.X;
      if(pivot.Y < smallestY) smallestY = (int) pivot.Y;
    }

    System.Drawing.Size offset = new System.Drawing.Size((int) thispivot.X - smallestX, (int) thispivot.Y - smallestY);

    documentIO.Document.TranslateObjects(offset, false);
    documentIO.Document.SelectAll();
    documentIO.Document.ExpireSolution();
    documentIO.Document.MutateAllIds();
    System.Collections.Generic.IEnumerable<IGH_DocumentObject> objs = documentIO.Document.Objects;
    GrasshopperDocument.DeselectAll();
    GrasshopperDocument.MergeDocument(documentIO.Document);
    GrasshopperDocument.UndoUtil.RecordAddObjectEvent("Paste", objs);
    //  documentIO.ClearClipboard(GH_ClipboardType.System);
    GrasshopperDocument.ScheduleSolution(10);
    List<IGH_DocumentObject> myDisabledObj = new List<IGH_DocumentObject>();
    myDisabledObj = GrasshopperDocument.DisabledObjects();

  }
# ---------- end placexmlsnippet ----------
from_flux_2 = FromFlux(
    Keys=flux.Keys,
    Mode=flow_control,
    keyId="4082566f6a4c3b9b7b26701fdb4b1c3b",
    mode="Constantly",
    Branch0_Path="{0}",
    Branch0_Item0_null_string=False,
    Branch0_Item0_string="""VReactorGen
p0
.""",
    Branch0_Item0_TypeName="Grasshopper.Kernel.Types.GH_String")  # -> Value, Meta
from_flux_3 = FromFlux(
    Keys=flux.Keys,
    Mode=flow_control,
    keyId="404722a83a22684e0079a179785efa64",
    mode="Constantly",
    Branch0_Path="{0;0;0}",
    Branch0_Item0_null_string=False,
    Branch0_Item0_string="""(lp0
F8.0
aF3.0
aF4.0
aF5.0
aF6.0
a.""",
    Branch0_Item0_TypeName="Grasshopper.Kernel.Types.GH_String",
    Branch0_Item1_null_string=False,
    Branch0_Item1_string="""(lp0
F0.59999999999999998
aF1.0
a.""",
    Branch0_Item1_TypeName="Grasshopper.Kernel.Types.GH_String",
    Branch0_Item2_null_string=False,
    Branch0_Item2_string="""(lp0
F0.0
aF2.0
a.""",
    Branch0_Item2_TypeName="Grasshopper.Kernel.Types.GH_String",
    Branch0_Item3_null_string=False,
    Branch0_Item3_string="""(lp0
F1.0
a.""",
    Branch0_Item3_TypeName="Grasshopper.Kernel.Types.GH_String",
    Branch0_Item4_null_string=False,
    Branch0_Item4_string="""(lp0
F0.90000000000000002
aF1.0
aF0.80000000000000004
a.""",
    Branch0_Item4_TypeName="Grasshopper.Kernel.Types.GH_String",
    Branch0_Item5_null_string=False,
    Branch0_Item5_string="""(lp0
F6.0
aF15.0
a.""",
    Branch0_Item5_TypeName="Grasshopper.Kernel.Types.GH_String",
    Branch0_Item6_null_string=False,
    Branch0_Item6_string="""(lp0
F2.0
aF3.0
a.""",
    Branch0_Item6_TypeName="Grasshopper.Kernel.Types.GH_String",
    Branch0_Item7_null_string=False,
    Branch0_Item7_string="""(lp0
F8.0
a.""",
    Branch0_Item7_TypeName="Grasshopper.Kernel.Types.GH_String")  # -> Value, Meta
from_flux_4 = FromFlux(
    Keys=flux.Keys,
    Mode=flow_control,
    keyId="40fc6dc0a9c8f0442f6624b91b6640f1",
    mode="Constantly",
    Branch0_Path="{0;0;0}",
    Branch0_Item0_null_string=False,
    Branch0_Item0_string="""VOutputShape-seg
p0
.""",
    Branch0_Item0_TypeName="Grasshopper.Kernel.Types.GH_String",
    Branch0_Item1_null_string=False,
    Branch0_Item1_string="""VPointY
p0
.""",
    Branch0_Item1_TypeName="Grasshopper.Kernel.Types.GH_String",
    Branch0_Item2_null_string=False,
    Branch0_Item2_string="""VAttF(x)
p0
.""",
    Branch0_Item2_TypeName="Grasshopper.Kernel.Types.GH_String",
    Branch0_Item3_null_string=False,
    Branch0_Item3_string="""VOutputShape
p0
.""",
    Branch0_Item3_TypeName="Grasshopper.Kernel.Types.GH_String",
    Branch0_Item4_null_string=False,
    Branch0_Item4_string="""VPointX
p0
.""",
    Branch0_Item4_TypeName="Grasshopper.Kernel.Types.GH_String",
    Branch0_Item5_null_string=False,
    Branch0_Item5_string="""VScale
p0
.""",
    Branch0_Item5_TypeName="Grasshopper.Kernel.Types.GH_String",
    Branch0_Item6_null_string=False,
    Branch0_Item6_string="""VGridType
p0
.""",
    Branch0_Item6_TypeName="Grasshopper.Kernel.Types.GH_String",
    Branch0_Item7_null_string=False,
    Branch0_Item7_string="""VAngle
p0
.""",
    Branch0_Item7_TypeName="Grasshopper.Kernel.Types.GH_String")  # -> Value, Meta
from_flux_5 = FromFlux(
    Keys=flux.Keys,
    Mode=flow_control,
    keyId="40b8bce9d56129e52fe444d295fc9af4",
    mode="Constantly",
    Branch0_Path="{0;0}",
    Branch0_Item0_number=23,
    Branch0_Item0_TypeName="Grasshopper.Kernel.Types.GH_Integer")  # -> Value, Meta
deserialize = PythonScript(input=from_flux_3.Value)  # -> output
# ---------- deserialize: Python ----------
import cPickle
output = cPickle.loads(input)
print output
print(type(output))
# ---------- end deserialize ----------
deserialize_2 = PythonScript(input=from_flux_4.Value)  # -> output; same code as deserialize
deserialize_3 = PythonScript(input=from_flux_2.Value)  # -> output; same code as deserialize
panel = Panel(from_flux_2.Value)
tree2list = PythonScript(intree=deserialize)  # -> outlist; inputs intree: tree
# ---------- tree2list: Python ----------
myList=[]
for i in range(intree.BranchCount):
    arr1 = []
    for j in range(len(intree.Branch(i))):
        arr1.append(intree.Branch(i)[j])
    myList.append(arr1)
    
outlist = myList
print outlist
# ---------- end tree2list ----------
cartesianproduct = PythonScript(kernel=tree2list)  # -> cproduct; inputs kernel: list
# ---------- cartesianproduct: Python ----------
import itertools
import cPickle

def generate_cproduct(matrix):
    #cartesian product
    product = []
    for item in itertools.product(*matrix):
        product.append(item)
    return product

cproduct = generate_cproduct(kernel)
print kernel
# ---------- end cartesianproduct ----------
selector = PythonScript(input=cartesianproduct, keys=deserialize_2, index=from_flux_5.Value, node_name=deserialize_3)  # -> out, node, alt; inputs input: list, keys: list
# ---------- selector: Python ----------
import cPickle
def get_alt(index, productlist,keys):
    i = int(index)%(len(productlist)) 
    selection = productlist[i]    
    rvec = dict()    
    nkeylist = []
    for key in keys:
        nkeylist.append(key)
    for key,value in zip(nkeylist,selection):
        rvec[key] = value
    return rvec

def update_model(rvec, node):
    for input in node.Params.Input:
        value = rvec[input.NickName]
        input.Sources[0].Slider.Value = value
    node.ExpireSolution(True)
    print "Updated "+node.NickName
    
def get_node(name):
    ghObjects = ghenv.Component.OnPingDocument().Objects
    for obj in ghObjects:
        if obj.NickName == name:
            return obj
    print "Node not found"
    
node = get_node(node_name)
_alt = get_alt(index, input, keys)
update_model(_alt, node)
alt = cPickle.dumps(_alt)
print _alt
print alt
# ---------- end selector ----------
grabnodeoutput = PythonScript(node=selector.node)  # -> result; disabled
# ---------- grabnodeoutput: Python ----------
print node.NickName
outputList = []
#for output in node.Params.Output:
#    outputList.append(output)
    
#result = outputList
#meh
result = node.Params.Output[0]
print result
#print outputList
# ---------- end grabnodeoutput ----------
to_flux_2 = ToFlux(Keys=flux.Keys, Value=grabnodeoutput, Mode=flow_control, keyId="40eb4de7d220ebd98aef0ffb841f45d5", mode="Constantly")  # disabled
to_flux_3 = ToFlux(Keys=flux.Keys, Value=selector.alt, Mode=flow_control, keyId="408642bb36ad94d34f040012d21f4c92", mode="Constantly")

outputshape_seg = Slider(8, range=3..8)
gridtype = Slider(2, range=0..4)
pointy = Slider(0.6, range=0..1)
attf_x = Slider(2, range=0..2)
scale = Slider(15, range=1..15)
outputshape = Slider(1, range=0..1)
pointx = Slider(0.8, range=0..1)
angle = Slider(8, range=0..100)
reactorgen = ReactorGen(G=gridtype, G_2=attf_x, G_3=outputshape, S=outputshape_seg, A=pointx, A_2=pointy, B=scale, A_3=angle)
flux_2 = FluxProject(project="a9jAyvE70YL3qR5WZ")  # -> Keys, Meta
flow_control_2 = FlowControl({"Once", "Constantly"}, selected="Constantly")
to_flux_4 = ToFlux(Keys=flux_2.Keys, Mode=flow_control_2, keyId="40eb4de7d220ebd98aef0ffb841f45d5", mode="Constantly")

# ==== cluster ReactorGen
A = ClusterInput()
A_2 = ClusterInput()
hexgrid = Hexagonal(Plane=PlaneXY(0, 0, 0), Size=8, ExtentX=10, ExtentY=8)  # -> Cells, Points
sqgrid = Square(Plane=PlaneXY(0, 0, 0), Size=10, ExtentX=10, ExtentY=10)  # -> Cells, Points
trigrid = Triangular(Plane=PlaneXY(0, 0, 0), Size=10, ExtentX=20, ExtentY=12)  # -> Cells, Points
radgrid = Radial(Plane=PlaneXY(50, 50, 0), Size=5, ExtentR=10, ExtentP=20)  # -> Cells, Points
pop2d = Populate2D(Region={Plane=PlaneXY(0, 0, 0), Size=Domain2(u=0..100, v=0..100)}, Count=100, Seed=1)
G = ClusterInput()
scaleup = Multiplication(A=A, B=100)
scaleup_2 = Multiplication(A=A_2, B=100)
pt = ConstructPoint(XCoordinate=scaleup, YCoordinate=scaleup_2, ZCoordinate=0)
gridtype = StreamFilter(Gate=G, Stream0=pop2d, Stream1=radgrid.Points, Stream2=trigrid.Points, Stream3=hexgrid.Points, Stream4=sqgrid.Points)
pt_2 = Point(pt)
linept_grid = Line(StartPoint=gridtype, EndPoint=pt_2)
G_2 = ClusterInput()
f_x_chooser = StreamFilter(Gate=G_2, Stream0="x/2", Stream1="x", Stream2="x*sin(x)")
len = Length(Curve=linept_grid)
B = ClusterInput()
eval = Evaluate(F=f_x_chooser, x=len)
scaledown = Division(A=eval, B=B)
A_3 = ClusterInput()
G_3 = ClusterInput()
outputtype = StreamGate(Stream=gridtype, Gate=G_3)  # -> Target0, Target1
S = ClusterInput()
circle = CircleCNR(Center=outputtype.Target0, Normal=Vector(0, 0, 1), Radius=scaledown)
polygon = Polygon(Plane=outputtype.Target1, Radius=scaledown, Segments=S, FilletRadius=0)  # -> Polygon, Length
rotate = Rotate(Geometry=polygon.Polygon, Angle=A_3, Plane=outputtype.Target1)  # -> Geometry, Transform
merge = Merge(Data1=circle, Data2=rotate.Geometry)
R = ClusterOutput(merge)
